# Grasshopper definition ThermalComfort.gh (Grasshopper 1.0.7)

pt = ConstructPoint(XCoordinate=0, YCoordinate=0, ZCoordinate=0)
pt_2 = ConstructPoint(XCoordinate=Slider(20, range=0..100), YCoordinate=Slider(20, range=0..100), ZCoordinate=Slider(10, range=0..100))
box = Box2Pt(PointA=pt, PointB=pt_2, Plane=PlaneXY(0, 0, 0))
bldgprograms = HBBuildingPrograms({"LargeOffice", "MediumOffice", "SmallOffice", "MidriseApartment", "HighriseApartment", "Retail", "StripMall", "PrimarySchool", "SecondarySchool", "SmallHotel", "LargeHotel", "Hospital", "Outpatient", "Laboratory", "Warehouse", "SuperMarket", "FullServiceRestaurant", "QuickServiceRestaurant", "Courthouse", "LargeDataCenterHighITE", "LargeDataCenterLowITE", "SmallDataCenterHighITE", "SmallDataCenterLowITE"}, selected="MidriseApartment")
searchprog = HBSearchPrograms(bldg_prog=bldgprograms, keywords="Apartment")  # -> room_prog; plug-in component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
roomsolid = HBRoomFromSolid(geo=flatten(box), name="Zone 1", program=searchprog, conditioned=Toggle(True))  # -> report, rooms; plug-in component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
aperturesbyratio = HBAperturesByRatio(hb_objs=flatten(roomsolid.rooms), ratio=Slider(0.22, range=0..1), subdivide=Toggle(True), operable=Toggle(True))  # -> report, hb_objs; plug-in component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
idealair = HBIdealAir(rooms=flatten(aperturesbyratio.hb_objs))  # -> report, rooms; plug-in component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
vizbytype = HBVisualizeByType(hb_objs=aperturesbyratio.hb_objs)  # -> walls, interior_walls, roofs, ceilings, exterior_floors, interior_floors, air_walls, apertures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; plug-in component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
model = HBModel(rooms=flatten(idealair.rooms))  # -> report, model; plug-in component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

# ---- group: Simulate
toggle = BooleanToggle(True)
simoutput = HBSimulationOutput(comfort_metrics=Toggle(True))  # -> report, sim_output; plug-in component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
simpar = HBSimulationParameter(output=simoutput.sim_output, timestep=6)  # -> sim_par; plug-in component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
open_weather_file = Ladybug_OpenEPWWeatherFile(open=Toggle(True))  # -> epwFile; plug-in component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
modeltoosm = HBModelToOSM(model=model.model, epw_file=open_weather_file, sim_par=simpar, write=toggle, run=toggle)  # -> report, jsons, osw, osm, idf, sql, zsz, rdd, html; plug-in component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

# ----
eui = HBEndUseIntensity(sql=modeltoosm.sql, ip=Toggle(True))  # -> eui, eui_end_use, end_uses, gross_floor; plug-in component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
panel = Panel(modeltoosm.idf)
panel_2 = Panel([eui.eui, eui.gross_floor])
roomcomfortresult = HBReadRoomComfortResult(sql=modeltoosm.sql)  # -> oper_temp, air_temp, rad_temp, rel_humidity; plug-in component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
xdata = LBDeconstructData(data=roomcomfortresult.air_temp)  # -> header, values; plug-in component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
outdoorsolarmrt = LBOutdoorSolarMRT()  # -> report, short_erf, long_erf, short_dmrt, long_dmrt, mrt; plug-in component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
panel_3 = Panel(xdata.values)
colorrooms = HBColorRooms(data=flatten(roomcomfortresult.air_temp), rooms_model=flatten(model.model))  # -> report, mesh, wire_frame, legend, title, rooms, colors, values; plug-in component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
indoorsolarmrt = LBIndoorSolarMRT()  # -> report, erf, dmrt, mrt; plug-in component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
